# Grasshopper definition readpts.gh (Grasshopper 0.9.76)

file = ReadFile(File="D:\HDD BACKUP\Work\elseware\041_MeetPods\Code\trails.txt", PerLineParse=True)
split = TextSplit(Text=file, Separators="/")
shift = ShiftList(List=split, Shift=-1, Wrap=False)
split_2 = TextSplit(Text=shift, Separators=",")
item = ListItem(List=split_2, Index=1, Wrap=True)
item_2 = ListItem(List=split_2, Index=0, Wrap=True)
item_3 = ListItem(List=split_2, Index=2, Wrap=True)
number_slider = Slider(0.32, range=0..1)
pt = ConstructPoint(XCoordinate=item_2, YCoordinate=item, ZCoordinate=item_3)
pshift = ShiftPaths(Data=pt, Offset=-1)
dom = ConstructDomain(DomainStart=expr("-x", number_slider), DomainEnd=number_slider)
dom_2 = ConstructDomain(DomainStart=expr("-x", number_slider), DomainEnd=number_slider)
crv = Curve([<curve referenced from the Rhino model> x75])
pline = PolyLine(Vertices=pshift, Closed=False)
rectangle = Rectangle(Plane=PlaneXY(0, 0, 0), XSize=dom, YSize=dom_2, Radius=0)  # -> Rectangle, Length
fillet = Fillet(Curve=crv, Radius=Slider(5, range=0..10))
vec = Vector(Vector(0, -10, -9.999999))
Z = UnitZ(Factor=1)
pframes = PerpFrames(Curve=fillet, Count=10, Align=True)  # -> Frames, Parameters
align = AlignPlane(Plane=pframes.Frames, Direction=Z)  # -> Plane, Angle
orient = Orient(Geometry=rectangle.Rectangle, Source=PlaneXY(0, 0, 0), Target=align.Plane)  # -> Geometry, Transform
swp1 = Sweep1(Rail=graft(fillet), Sections=orient.Geometry, Miter=1)
