# Grasshopper definition unnamed.gh (Grasshopper 0.9.76)

geo = Geometry(<brep referenced from the Rhino model>)
range = Range(Domain=Domain(0, 1), Steps=Slider(40, range=0..100))
range_2 = Range(Domain=Domain(0, 1), Steps=Slider(40, range=0..100))
range_3 = Range(Domain=Domain(0, 1), Steps=Slider(3, range=0..100))
bbox = BoundingBox(Content=geo, Plane=PlaneXY(0, 0, 0))  # -> Box, Box_2
crossref = CrossReference(ListA=range, ListB=range_3, CrossMode=1)  # -> ListA, ListB
box = EvaluateBox(Box=bbox.Box, UParameter=graft(range_2), VParameter=crossref.ListA, WParameter=crossref.ListB)  # -> Plane, Point, Include
brepinc = PointInBrep(Brep=geo, Point=box.Point, Strict=False)
cull = CullPattern(List=box.Point, CullPattern=brepinc)
pt = Point(flatten(cull))
reduce = RandomReduce(List=flatten(cull), Reduction=Slider(536, range=0..1000), Seed=1)
geo_2 = Geometry(<brep referenced from the Rhino model>)
box_2 = Box()
cull_2 = CullPattern(List=pt, CullPattern=[False, True])
brepinc_2 = PointInBrep(Brep=geo_2, Point=cull_2, Strict=False)
cull_3 = CullPattern(List=cull_2, CullPattern=brepinc_2)
line = LineSDL(Start=cull_3, Direction=Vector(0, 0, 1), Length=900)
divide = DivideCurve(Curve=line, Count=5, Kinks=False)  # -> graft(Points), Tangents, Parameters
pdecon = Deconstruct(Point=divide.Points)  # -> XComponent, YComponent, ZComponent
join = TextJoin(Text=[pdecon.XComponent, pdecon.YComponent, pdecon.ZComponent], Join=",")
pshift = ShiftPaths(Data=join, Offset=-1)
join_2 = TextJoin(Text=pshift, Join="/")  # -> flatten(Result)
panel = Panel(join_2)
